# Dynamo graph Core-Scripting.dyn (Dynamo 2.19.3.6394)
# packages: Orchid 2.19.5.6567

# group: Python -> the "old" way
string = StringInput("%OrchidSamples%\Data\")  # graph input
string_2 = StringInput("ScriptTest.py")  # graph input
contents = Orchid.Common.Directory.Contents(directory=string, searchString=string_2)
readText = FileSystem.ReadText(file=contents)
watch = Watch(readText)
python_script_from_string = PythonStringNode(script=readText)  # CPython3
watch_2 = Watch(python_script_from_string)

# group: Python
string_3 = StringInput("%OrchidSamples%\Data\")  # graph input
string_4 = StringInput("ScriptTest.py")  # graph input
boolean = BoolSelector(false)  # graph input
scriptFileReader = Orchid.Common.Scripting.ScriptFileReader(path=string_3, file=string_4, refresh=boolean)
python_script_from_string_2 = PythonStringNode(script=scriptFileReader)  # CPython3
watch_3 = Watch(python_script_from_string_2)
watch_4 = Watch(scriptFileReader)

# group: Python
code_block = CodeBlock()
# ---------- code_block.designscript (6 lines) ----------
t1 = "%OrchidSamples%\\Data\\";
t2 = Orchid.Common.Directory.FromPath(t1);
t3 = "ScriptTest.py";
t4 = false;

Orchid.Common.Scripting.ScriptFileReader(t2, t3, t4);
# ----------------------------------------
watch_5 = Watch(code_block.out4)
python_script_from_string_3 = PythonStringNode(script=code_block.out4)  # CPython3
watch_6 = Watch(python_script_from_string_3)

# group: File from path
string_5 = StringInput("%OrchidSamples%\Data\ScriptTest.py")  # graph input
fromPath = Orchid.Common.File.FromPath(path=string_5)
readText_2 = FileSystem.ReadText(file=fromPath)
watch_7 = Watch(readText_2)
watch_8 = Watch(fromPath)

# group: directory from path
string_6 = StringInput("%OrchidSamples%\Data\testSet")  # graph input
fromPath_2 = Orchid.Common.Directory.FromPath(path=string_6)
contents_2 = Orchid.Common.Directory.Contents(directory=fromPath_2)
watch_9 = Watch(contents_2)
watch_10 = Watch(fromPath_2)

# group: Dynamo Packages and Definitions Path
packagesPath = Orchid.AdeskApps.Dynamo.PackagesPath()
watch_11 = Watch(packagesPath)
code_block_2 = CodeBlock { Orchid.AdeskApps.Dynamo.PackagesPath; Orchid.AdeskApps.Dynamo.DefinitionsPath; }
watch_12 = Watch(code_block_2.out0)
definitionsPath = Orchid.AdeskApps.Dynamo.DefinitionsPath()
watch_13 = Watch(definitionsPath)
watch_14 = Watch(code_block_2.out1)

# group: Filter by Type
code_block_3 = CodeBlock { 2..5..0.5; [2,2.5,3,3.5,4,4.5,5]; }
code_block_4 = CodeBlock { "System.Double"; "System.Int32"; "System.Int64"; }
toClass = Orchid.Common.String.ToClass(string=code_block_4.out0)
isClassOf = Orchid.Common.Object.IsClassOf(object=code_block_3.out1, class=toClass)
watch_15 = Watch(isClassOf)

# group: CSV writer with delimiter
string_7 = StringInput("%OrchidSamples%\Data\")  # graph input
fromPath_3 = Orchid.Common.Directory.FromPath(path=string_7)
code_block_5 = CodeBlock(dir=fromPath_3) { dir + "test.csv"; }
string_8 = StringInput("\n")
code_block_6 = CodeBlock { ["Hello","World"]; }
sort = List.Sort(list=code_block_6)
join = String.Join(separator=string_8, string0=sort)
writeText = FileSystem.WriteText(filePath=code_block_5, text=join)
watch_16 = Watch(join)

# group: Filter a list by Null values as the mask
code_block_7 = CodeBlock()
# ---------- code_block_7.designscript (3 lines) ----------
"A".."H";
["X","X",null,"X",
null,null,"X",null];
# ----------------------------------------
filterByNullMask = Orchid.Common.List.FilterByNullMask(list=code_block_7.out0, mask=code_block_7.out1)
watch_17 = Watch(filterByNullMask.out)
watch_18 = Watch(filterByNullMask.in)

# group: Await
code_block_8 = CodeBlock { [1..5,1..5,1..5]; }
code_block_9 = CodeBlock { ["a".."e","a".."e"]; }
await_ = Orchid.Common.DataStream.Await(pass=code_block_8, waitFors=code_block_9)
watch_19 = Watch(await_)

# group: Circut
code_block_10 = CodeBlock { [1..5,1..5,1..5]; }
boolean_2 = BoolSelector(true)  # graph input
circut = Orchid.Common.DataStream.Circut(pass=code_block_10, state=boolean_2)
watch_20 = Watch(circut)

# group: Current directory
current = Orchid.Common.Directory.Current()
watch_21 = Watch(current)

# group: Current dynamo graph file
graphPath = Orchid.AdeskApps.Dynamo.GraphPath()
watch_22 = Watch(graphPath)

# group: About the package
info = Orchid.About.Info()
watch_23 = Watch(info)

# group: Update the package
update = Orchid.About.Update()
watch_24 = Watch(update)
