# Dynamo graph DateTime.dyn (Dynamo 2.19.3.6394)
# packages: Orchid 2.19.3.6432

# group: DateTime
now = DateTime.Now()
code_block = CodeBlock { "da-DK"; "en-GB"; "es-ES"; "fr-FR"; "de-DE"; "zh-Hant"; "ja-JP"; "en-US"; }
byName = Orchid.Common.Global.Culture.ByName(name=code_block.out0)
now_2 = Orchid.Common.Global.DateTime.Now(culture=byName)
byName_2 = Orchid.Common.Global.Culture.ByName(name=code_block.out5)
setDateTime = Orchid.Common.Global.Culture.SetDateTime(culture=byName_2)
now_3 = Orchid.Common.Global.DateTime.Now(culture=setDateTime)
byName_3 = Orchid.Common.Global.Culture.ByName(name=code_block.out7)
edit = Orchid.Common.Global.Culture.Edit(culture=byName_3)
string = StringInput("\"%a, %d %b %Y %H:%M:%S\"")
setDateTime_2 = Orchid.Common.Global.Culture.SetDateTime(culture=edit, full=string)
now_4 = Orchid.Common.Global.DateTime.Now(culture=setDateTime_2)
list_create = List.Create(item0=now, item1=now_2, item2=now_3, item3=now_4)
culture = Culture("da-DK")
culture_2 = Culture("en-US")

watch = Watch(list_create)
