# Dynamo graph Directory-Rename.dyn (Dynamo 2.19.3.6394)
# packages: Orchid 2.19.3.6432

# group: Open all files in directory and sub directories
string = StringInput("%OrchidSamples%\Data\testSet")  # graph input
code_block = CodeBlock { "*.rfa"; false; }
contents = Orchid.Common.Directory.Contents(directory=string, searchString=code_block.out0, deepSearch=code_block.out1)

watch = Watch(contents)
directory_path = StringInput("%OrchidSamples%\Data\testSet")  # graph input
code_block_2 = CodeBlock { "*.rfa"; false; }
contents_2 = Orchid.Common.Directory.Contents(directory=directory_path, searchString=code_block_2.out0, deepSearch=code_block_2.out1)
partition = DoubleInput(1)  # graph input
sliced_into = DoubleInput(2)  # graph input
count = List.Count(list=contents_2)
code_block_3 = CodeBlock(partition=partition, sliced=sliced_into, count=count)
# ---------- code_block_3.designscript (4 lines) ----------
//start
Math.Floor(((partition-1)/sliced)*count);
//end
Math.Ceiling((partition/sliced)*count);
# ----------------------------------------
slice = List.Slice(list=contents_2, start=code_block_3.out0, end=code_block_3.out1)
watch_2 = Watch(slice)
code_block_4 = CodeBlock { false; }
fileName = FileSystem.FileName(path=contents, withExtension=code_block_4)

# group: rename all files in directory and sub directories
string_2 = StringInput("%OrchidSamples%\Data\testSet")  # graph input
code_block_5 = CodeBlock()
# ---------- code_block_5.designscript (3 lines) ----------
"rfa";
//new names (check list length)
["dummy1","dummy2"];
# ----------------------------------------
rename = Orchid.Common.File.Rename(directory=string_2, extension=code_block_5.out0, sourceName=fileName, targetName=code_block_5.out1)

watch_3 = Watch(rename)
