# Dynamo graph Dynamo Application.dyn (Dynamo 2.19.3.6394)
# packages: Orchid 2.19.3.6432

# group: User default Packages and Definitions Path
code_block = CodeBlock { Orchid.AdeskApp.Dynamo.DefaultPackagesPath; Orchid.AdeskApp.Dynamo.DefaultDefinitionsPath; }
watch = Watch(code_block.out0)
watch_2 = Watch(code_block.out1)
defaultDefinitionsPath = Orchid.AdeskApp.Dynamo.DefaultDefinitionsPath()
watch_3 = Watch(defaultDefinitionsPath)
defaultPackagesPath = Orchid.AdeskApp.Dynamo.DefaultPackagesPath()
watch_4 = Watch(defaultPackagesPath)

# group: Packages and Definitions Path
definitionsPath = Orchid.AdeskApp.Dynamo.DefinitionsPath()
watch_5 = Watch(definitionsPath)
packagesPath = Orchid.AdeskApp.Dynamo.PackagesPath()
watch_6 = Watch(packagesPath)

# group: Dynamo info
graphPath = Orchid.AdeskApp.Dynamo.GraphPath()
watch_7 = Watch(graphPath)
graphGuid = Orchid.AdeskApp.Dynamo.GraphGuid()
watch_8 = Watch(graphGuid)
version = Orchid.AdeskApp.DynamoCore.Version()
watch_9 = Watch(version)
versionBuild = Orchid.AdeskApp.DynamoCore.VersionBuild()
watch_10 = Watch(versionBuild)
applicationFolder = Orchid.AdeskApp.Dynamo.ApplicationFolder()
watch_11 = Watch(applicationFolder)
version_2 = Orchid.AdeskApp.DynamoRevit.Version()
watch_12 = Watch(version_2)
versionBuild_2 = Orchid.AdeskApp.DynamoRevit.VersionBuild()
watch_13 = Watch(versionBuild_2)
