# Dynamo graph File.NewProject.dyn (Dynamo 3.6.1.9895)
# packages: Orchid 3.6.0.6844

# group: Template and New Projects
directory_path = StringInput("%OrchidSamples%\Data\testSet\")  # graph input
project_file_name = CodeBlock { ["new1", "new2"]; }
extension = StringInput(".rvt")  # graph input
code_block = CodeBlock(a=directory_path, b=project_file_name, c=extension) { a+b+c; }
template_path = StringInput("%OrchidSamples%\Data\2026_Data\DanEDU Template.rte")  # graph input

newProject = Orchid.RevitProject.Common.Document.NewProject(file=code_block, template=template_path)
watch = Watch(newProject)
watch_2 = Watch(template_path)
