# Dynamo graph List.SummationByKey.dyn (Dynamo 2.16.1.2727)
# packages: Orchid 216.3.0.5794

code_block = CodeBlock { "Walls"; }
byName = Category.ByName(name=code_block)
all_elements_of_category = ElementsOfCategory(Category=byName)
code_block_2 = CodeBlock { "Area"; }
getParameterValueByName = Element.GetParameterValueByName(element=all_elements_of_category, parameterName=code_block_2)
code_block_3 = CodeBlock(x=getParameterValueByName) { x:int[]; }
code_block_4 = CodeBlock { "Family"; }
getParameterValueByName_2 = Element.GetParameterValueByName(element=all_elements_of_category, parameterName=code_block_4)
groupByKey = List.GroupByKey(list=getParameterValueByName, keys=getParameterValueByName_2)
type = Object.Type(object=groupByKey.groups)
summationByKey = Orchid.Common.List.SummationByKey(list=getParameterValueByName, keys=getParameterValueByName_2)
watch = Watch(summationByKey.unique_keys)
watch_2 = Watch(summationByKey.summarized_groups)
groupByEqual = Orchid.Common.List.GroupByEqual(list=getParameterValueByName_2)
watch_3 = Watch(groupByEqual.groups)
type_2 = Object.Type(object=summationByKey.summarized_groups)
watch_4 = Watch(groupByEqual.unique_keys)
type_3 = Object.Type()  # unwired: object
name = Element.Name(element=groupByKey.uniqueKeys)
watch_5 = Watch(name)
watch_6 = Watch(groupByKey.uniqueKeys)
watch_7 = Watch(groupByKey.groups)
