# Dynamo graph MergePDF.dyn (Dynamo 2.19.3.6394)
# packages: Orchid 2.19.3.6432

code_block = CodeBlock()
# ---------- code_block.designscript (6 lines) ----------
//input documents
["C:\\Users\\Public\\Temp\\pdf\\pdf1.pdf",
"C:\\Users\\Public\\Temp\\pdf\\pdf2.pdf"];

//output file path
"C:\\Users\\Public\\Temp\\PDF\\result.pdf";
# ----------------------------------------
mergePDF = Orchid.Common.File.MergePDF(documents=code_block.out0, filePath=code_block.out1)
