# Dynamo graph Timer.dyn (Dynamo 2.19.3.6394)
# packages: Orchid 2.19.3.6432

# group: Important! Place DateTime.Now in upper left corner of the graph to get the correct time elapsed
code_block = CodeBlock { 1..80000; }
now = DateTime.Now()
timer = Orchid.Common.DataStream.Timer(pass=code_block, dateTime=now)
mul = timer.pass * timer.pass
timer_2 = Orchid.Common.DataStream.Timer(pass=mul, dateTime=timer.DateTime)
totalSeconds = TimeSpan.TotalSeconds(timeSpan=timer_2.TimeSpan)
watch = Watch(totalSeconds)
totalMilliseconds = TimeSpan.TotalMilliseconds(timeSpan=timer_2.TimeSpan)
watch_2 = Watch(totalMilliseconds)
