# Dynamo graph AddConvert.dyn (Dynamo 2.16.2.5624)
# packages: Orchid 2.16.4.6198

# group: create family type
current = Orchid.RevitFamily.FamilyDocument.Current()
create = Orchid.RevitFamily.FamilyType.Create(familyDocument=current)
name = Orchid.RevitFamily.FamilyType.Name(familyType=create)

# group: Add shared parameter
# File: defaultFamily
await_ = Orchid.Common.DataStream.Await(pass=current, waitFor=create)
code_block = CodeBlock()
# ---------- code_block.designscript (14 lines) ----------
//Parameter name
["Creator Name",
"Creator Organization",
"Creator Build"];
//SP Parameter group
"Sheet & Project";
//GroupType
"AdskModelProperties";
//Instances
true;
//Reporting
true;
//Condense output
false;
# ----------------------------------------
byName = Orchid.AdeskApp.GroupType.ByName(string=code_block.out2)
add = Orchid.RevitFamily.SharedParameter.Add(familyDocument=await_, parameterName=code_block.out0, groupName=code_block.out1, groupType=byName, instance=code_block.out3)

# group: Toggle shared to family parameter and vice versa
toggleFamilyShared = Orchid.RevitFamily.FamilyParameter.ToggleFamilyShared(familyDocument=await_, parameter=add)
code_block_2 = CodeBlock { true; }
toggleFamilyShared_2 = Orchid.RevitFamily.FamilyParameter.ToggleFamilyShared(familyDocument=await_, parameter=toggleFamilyShared, shared=code_block_2)
name_2 = FamilyParameter.Name(familyParameter=toggleFamilyShared_2)
watch = Watch(name_2)

# group: Set formula
await_2 = Orchid.Common.DataStream.Await(pass=current, waitFor=add)
code_block_3 = CodeBlock()
# ---------- code_block_3.designscript (8 lines) ----------
//Parameter name
["Creator Name",
"Creator Organization",
"Creator Build"];
//Values
["\"Erik Falck Jørgensen\"",
"\"Danish Educational Content\"",
"\"2022.0406.0\""];
# ----------------------------------------
input = Orchid.RevitFamily.Formula.Input(familyDocument=await_2, parameterName=code_block_3.out0, value=code_block_3.out1)

# group: Get Formula
await_3 = Orchid.Common.DataStream.Await(pass=await_2, waitFor=input)
code_block_4 = CodeBlock()
# ---------- code_block_4.designscript (4 lines) ----------
//Parameter name
["Creator Name",
"Creator Organization",
"Creator Build"];
# ----------------------------------------
value = Orchid.RevitFamily.Formula.Value(familyDocument=await_3, parameterName=code_block_4)
watch_2 = Watch(value)

# group: Remove formula
await_4 = Orchid.Common.DataStream.Await(pass=await_3, waitFor=value)
code_block_5 = CodeBlock()  # same code as code_block_4
remove = Orchid.RevitFamily.Formula.Remove(familyDocument=await_4, parameterName=code_block_5)

# group: Set parameter value
await_5 = Orchid.Common.DataStream.Await(pass=await_4, waitFor=remove)
code_block_6 = CodeBlock()
# ---------- code_block_6.designscript (8 lines) ----------
//Parameter name
["Creator Name",
"Creator Organization",
"Creator Build"];
//value
["name","org","build"];
//Condense output
false;
# ----------------------------------------
setValue = Orchid.RevitFamily.FamilyParameter.SetValue(familyDocument=await_5, parameterName=code_block_6.out0, value=code_block_6.out1)

types = FamilyDocument.Types(familyDocument=await_)
watch_3 = Watch(types)

# group: Create shared parameter
await_6 = Orchid.Common.DataStream.Await(pass=current, waitFor=create)
code_block_7 = CodeBlock()
# ---------- code_block_7.designscript (8 lines) ----------
//Parameter name
"Dynamo test parameter";
//SP Parameter group
"Dynamo test group";
//SpecType
"Text";
//GroupType
"AdskModelProperties";
# ----------------------------------------
byName_2 = Orchid.AdeskApp.SpecType.ByName(string=code_block_7.out2)
byName_3 = Orchid.AdeskApp.GroupType.ByName(string=code_block_7.out3)
create_2 = Orchid.RevitFamily.SharedParameter.Create(familyDocument=await_6, parameterName=code_block_7.out0, groupName=code_block_7.out1, specType=byName_2, groupType=byName_3)

# group: Converters (to/from Revit API)
toRevitType = Orchid.Common.Object.ToRevitType(object=create_2)
toDynamoType = Orchid.Common.Object.ToDynamoType(object=toRevitType)
watch_4 = Watch(toDynamoType)
watch_5 = Watch(toRevitType)

# group: Add family parameter
await_7 = Orchid.Common.DataStream.Await(pass=current, waitFor=create)
code_block_8 = CodeBlock()
# ---------- code_block_8.designscript (6 lines) ----------
//Parameter name
["test1","test2"];
//SpecType
"Text";
//GroupType
"AdskModelProperties";
# ----------------------------------------
byName_4 = Orchid.AdeskApp.SpecType.ByName(string=code_block_8.out1)
byName_5 = Orchid.AdeskApp.GroupType.ByName(string=code_block_8.out2)
create_3 = Orchid.RevitFamily.FamilyParameter.Create(familyDocument=await_7, parameterName=code_block_8.out0, specType=byName_4, groupType=byName_5)

# group: Toogle instance to type and change group
await_8 = Orchid.Common.DataStream.Await(pass=await_7, waitFor=create_3)
code_block_9 = CodeBlock()
# ---------- code_block_9.designscript (4 lines) ----------
//Instances
true;
//GroupType
"Text";
# ----------------------------------------
toggleInstanceType = Orchid.RevitFamily.FamilyParameter.ToggleInstanceType(familyDocument=await_8, parameter=create_3, instance=code_block_9.out0)
byName_6 = Orchid.AdeskApp.GroupType.ByName(string=code_block_9.out1)
changeGroup = Orchid.RevitFamily.FamilyParameter.ChangeGroup(familyDocument=await_8, parameter=toggleInstanceType, groupType=byName_6)

# group: Dynamo FamilyDocument
current_2 = Document.Current()
byDocument = FamilyDocument.ByDocument(document=current_2)
