# Dynamo graph Form.dyn (Dynamo 2.19.3.6394)
# packages: Orchid 2.19.3.6432

# group: 
# File: 3solid.rfa (Geometry folder)
element_classes = ElementTypes("Extrusion")
all_elements_of_class = ElementsOfType(element_class=element_classes)
solids = Element.Solids(element=all_elements_of_class)
watch = Watch(solids)
dynamoSolid = Orchid.Geometry.Form.DynamoSolid(form=all_elements_of_class)
watch_2 = Watch(dynamoSolid)
element_classes_2 = ElementTypes("FreeFormElement")

# group: Dynamo Solid
get = Orchid.Geometry.Form.Get()
dynamoSolid_2 = Orchid.Geometry.Form.DynamoSolid(form=get)
flatten = List.Flatten(list=dynamoSolid_2)
watch_3 = Watch(flatten)
intersect = Orchid.Geometry.DynamoSolid.Intersect(dynamoSolid=flatten)
watch_4 = Watch(intersect)
byUnion = Solid.ByUnion(solids=flatten)
area = Solid.Area(solid=byUnion)
watch_5 = Watch(area)
volume = Solid.Volume(solid=byUnion)
watch_6 = Watch(volume)
watch_7 = Watch(byUnion)
toOrchidType = Orchid.Geometry.DynamoSolid.ToOrchidType(dynamoSolid=byUnion)
watch_8 = Watch(toOrchidType)

# group: Revit Solid
get_2 = Orchid.Geometry.Form.Get()
revitSolid = Orchid.Geometry.Form.RevitSolid(form=get_2)
flatten_2 = List.Flatten(list=revitSolid)
intersect_2 = Orchid.Geometry.RevitSolid.Intersect(revitSolid=flatten_2)
watch_9 = Watch(intersect_2)
watch_10 = Watch(flatten_2)
union = Orchid.Geometry.RevitSolid.Union(revitSolid=flatten_2)
area_2 = Orchid.Geometry.RevitSolid.Area(revitSolid=union)
watch_11 = Watch(area_2)
volumne = Orchid.Geometry.RevitSolid.Volumne(revitSolid=union)
watch_12 = Watch(volumne)
watch_13 = Watch(union)
toDynamoType = Orchid.Geometry.RevitSolid.ToDynamoType(revitSolid=union)
watch_14 = Watch(toDynamoType)
