# Dynamo graph FormSetGet.dyn (Dynamo 3.6.1.9895)
# packages: Orchid 3.6.0.6860

# group: Create FamilyType based parameter
code_block = CodeBlock()
# ---------- code_block.designscript (6 lines) ----------
//Parameter name
"Nested Family";
//SpecType
"Generic Models";
//GroupType
"AdskModelProperties";
# ----------------------------------------
byName = Category.ByName(name=code_block.out1)
byName_2 = Orchid.AdeskApps.Units.GroupType.ByName(string=code_block.out2)
create = Orchid.RevitFamily.FamilyParameter.Create(parameterName=code_block.out0, category=byName, groupType=byName_2)

# group: Create ordinary parameter
# File: defaultFamily
code_block_2 = CodeBlock()
# ---------- code_block_2.designscript (6 lines) ----------
//Parameter name
"Material";
//SpecType
"Material";
//GroupType
"AdskModelProperties";
# ----------------------------------------
byName_3 = Orchid.AdeskApps.Units.SpecType.ByName(string=code_block_2.out1)
byName_4 = Orchid.AdeskApps.Units.GroupType.ByName(string=code_block_2.out2)
create_2 = Orchid.RevitFamily.FamilyParameter.Create(parameterName=code_block_2.out0, specType=byName_3, groupType=byName_4)

# group: Set parameter
materials = Material("Glass")  # graph input
setValue = Orchid.RevitFamily.FamilyParameter.SetValue(familyParameter=create_2, value=materials)

# group: Select geometry
element_classes = ElementTypes("Extrusion")
all_elements_of_class = ElementsOfType(element_class=element_classes)

# group: Associate parameter
code_block_3 = CodeBlock()
# ---------- code_block_3.designscript (2 lines) ----------
//Parameter name
"Material";
# ----------------------------------------
byName_5 = Orchid.RevitProject.Parameters.Parameter.ByName(element=all_elements_of_class, parameterName=code_block_3)
associate = Orchid.RevitFamily.FamilyParameter.Associate(familyParameter=setValue, element=all_elements_of_class, elementParameter=byName_5)
