# Dynamo graph NestedByCategory.dyn (Dynamo 3.6.1.9895)
# packages: Orchid 3.6.0.6861

# group: 
# File: defaultFamily
code_block = CodeBlock { "Level Heads"; }
byName = Category.ByName(name=code_block)
nestedByCategory = Orchid.RevitFamily.Family.NestedByCategory(category=byName)
watch = Watch(nestedByCategory)

nested = Orchid.RevitFamily.Family.Nested()
watch_2 = Watch(nested.Family)
watch_3 = Watch(nested.Category)
