# Dynamo graph PurgeFamilyDocument.dyn (Dynamo 2.19.3.6394)
# packages: Orchid 2.19.5.6567

# group: Imported dwg files etc.
purge = Orchid.Revit.Common.Imports.Purge()  # frozen
code_block = CodeBlock { "ImportInstance"; }  # frozen
classByName = Orchid.AdeskApps.Revit.ClassByName(name=code_block)
ofClass = Orchid.RevitProject.Elements.Element.OfClass(class=classByName)
delete = Orchid.RevitProject.Elements.Element.Delete(element=ofClass)

# group: Imported lines from dwg files etc.
deleteImported = Orchid.RevitProject.Categories.Category.DeleteImported()  # frozen
code_block_2 = CodeBlock { "Imports in Families"; }  # frozen
byName = Category.ByName(name=code_block_2)
delete_2 = Orchid.RevitProject.Categories.SubCategory.Delete(subCategory=byName)
byCategory = Orchid.RevitProject.Categories.SubCategory.ByCategory(category=byName)
imported = Orchid.RevitProject.Categories.Category.Imported()  # frozen
delete_3 = Orchid.RevitProject.Elements.Element.Delete(element=imported)

# group: 
# All is included in FamilyDocument.Purge
purge_2 = Orchid.Revit.Geometry.LinePattern.Purge()  # frozen
purge_3 = Orchid.RevitFamily.FamilyParameter.Purge()  # frozen

# group: 
# All is included in FamilyDocument.Purge
purge_4 = Orchid.RevitMaterial.Material.Purge()  # frozen
purge_5 = Orchid.RevitMaterial.Visual.Asset.Purge()  # frozen

# group: FamilyDocument purge
boolean = BoolSelector(true)  # graph input
purge_6 = Orchid.RevitFamily.FamilyDocument.Purge(completely=boolean)

# group: PostCommand
boolean_2 = BoolSelector(false)  # graph input
purge_7 = Orchid.Revit.Common.PostCommand.Purge(activate=boolean_2)  # frozen
