# Dynamo graph Apperance.dyn "Apperance_R23" (Dynamo 2.16.1.2727)
# packages: Orchid 216.3.0.5828

# group: All
inDocument = Orchid.RevitMaterial.Appearance.InDocument()
watch = Watch(inDocument)
name = Element.Name(element=inDocument)
watch_2 = Watch(name)

# group: Duplicate
code_block = CodeBlock { "Default Wall"; "_xx"; }
byName = Orchid.RevitMaterial.Appearance.ByName(name=code_block.out0)
duplicate = Orchid.RevitMaterial.Appearance.Duplicate(appearance=byName, name=code_block.out1)
watch_3 = Watch(duplicate)
appearances = Appearance("Default Wall")  # graph input

# group: Create appearance and material: Timber (C24)
code_block_2 = CodeBlock { "_Timber C24"; "GenericSchema"; "HardwoodSchema"; }
create = Orchid.RevitMaterial.Material.Create(name=code_block_2.out0)
create_2 = Orchid.RevitMaterial.Appearance.Create(name=code_block_2.out0, schema=code_block_2.out1)
setAppearance = Orchid.RevitMaterial.Material.SetAppearance(material=create, appearance=create_2)
watch_4 = Watch(setAppearance)
name_2 = Material.Name(material=setAppearance)
watch_5 = Watch(name_2)

# group: Material Appearance Asset
code_block_3 = CodeBlock { "Default"; "Copper - Brushed"; }
byName_2 = Material.ByName(name=code_block_3.out0)
byName_3 = Orchid.RevitMaterial.Appearance.ByName(name=code_block_3.out1)
setAppearance_2 = Orchid.RevitMaterial.Material.SetAppearance(material=byName_2, appearance=byName_3)
watch_6 = Watch(setAppearance_2)

# group: Asset handling
asset_schemas = AssetSchema("Concrete")
boolean = BoolSelector(false)
bySchema = Orchid.RevitMaterial.Visual.Asset.BySchema(schema=asset_schemas, default=boolean)
code_block_4 = CodeBlock(t=bySchema) { "_test1"; t[0]; }
create_3 = Orchid.RevitMaterial.Appearance.Create(name=code_block_4.out0, asset=code_block_4.out1)
category = Orchid.RevitMaterial.Visual.Asset.Category(asset=bySchema)
byCategory = Orchid.RevitMaterial.Visual.Asset.ByCategory(category=category)
code_block_5 = CodeBlock()
# ---------- code_block_5.designscript (36 lines) ----------
// Asset Schemas

// Ceramic
"CeramicSchema";
// Concrete
"ConcreteSchema";
// Generic
"GenericSchema";
// Glazing
"GlazingSchema";
// Layered
"PrismLayeredSchema";
// Masonry
"MasonryCMUSchema";
// Metal
"PrismMetalSchema";
// Metalic Paint
"MetallicPaintSchema";
// Mirror
"MirrorSchema";
// Opaque
"PrismOpaqueSchema";
// Plastic
"PlasticVinylSchema";
// Solid Glass
"SolidGlassSchema";
// Stone
"StoneSchema";
// Transparent
"PrismTransparentSchema";
// Wall Paint
"WallPaintSchema";
// Water
"WaterSchema";
// Wood
"HardwoodSchema";
# ----------------------------------------
bySchema_2 = Orchid.RevitMaterial.Visual.Asset.BySchema(schema=code_block_5.out0, default=boolean)
toRevitType = Orchid.Common.Object.ToRevitType(object=bySchema_2)
watch_7 = Watch(toRevitType)
toOrchidType = Orchid.Common.Object.ToOrchidType(object=toRevitType)
watch_8 = Watch(toOrchidType)

# group: Material Appearance: Timber (C24)
# File: defaultProject
code_block_6 = CodeBlock { "_Timber C24"; }
byName_4 = Orchid.RevitMaterial.Appearance.ByName(name=code_block_6)
code_block_7 = CodeBlock()
# ---------- code_block_7.designscript (6 lines) ----------
// Description
"Hardwood material";
// Keyword
"pine,wood,interior,
furniture,materials,
hardwood";
# ----------------------------------------
setInformation = Orchid.RevitMaterial.Appearance.SetInformation(appearance=byName_4, description=code_block_7.out0, keyword=code_block_7.out1)
code_block_8 = CodeBlock { 145; 15; 65; }
byARGB = Color.ByARGB(red=code_block_8.out0, green=code_block_8.out1, blue=code_block_8.out2)
string = StringInput("%userprofile%\Programming\Testing\Data\Stone_3.bmp")  # graph input
fromPath = Orchid.Common.File.FromPath(path=string)
image = Orchid.RevitMaterial.Visual.Texture.Image(path=fromPath)
code_block_9 = CodeBlock { 70; 50; true; }
slider = Orchid.RevitMaterial.Visual.Texture.Slider(value=code_block_9.out1)
setGeneric = Orchid.RevitMaterial.Appearance.SetGeneric(appearance=setInformation, color=byARGB, texture=image, imageFade=code_block_9.out0, glossiness=slider, highlights=code_block_9.out2)
code_block_10 = CodeBlock { 40; }
setReflectivity = Orchid.RevitMaterial.Appearance.SetReflectivity(appearance=setGeneric, direct=code_block_10, oblique=code_block_10)
code_block_11 = CodeBlock { 35; 90; 15; 1.52; }
slider_2 = Orchid.RevitMaterial.Visual.Texture.Slider(value=code_block_11.out2)
transparency_refractions = TransparencyRefraction("Alcohol")
setTransparency = Orchid.RevitMaterial.Appearance.SetTransparency(appearance=setReflectivity, amount=code_block_11.out0, texture=image, imageFade=code_block_11.out1, translucency=slider_2, refraction=transparency_refractions)
setCutouts = Orchid.RevitMaterial.Appearance.SetCutouts(appearance=setTransparency, texture=image)
code_block_12 = CodeBlock { Color.ByARGB(255, 205, 135, 165); 10.0; 6500.0; }
color = Orchid.RevitMaterial.Visual.Texture.Color(color=code_block_12.out0)
self_illumination_luminances = SelfIlluminationLuminance("Cell Phone Screen")
self_illumination_color = SelfIlluminationColorTemperatur("Moonlight")  # "Self Illumination Color Temperatures"
setSelfIllumination = Orchid.RevitMaterial.Appearance.SetSelfIllumination(appearance=setCutouts, texture=color, luminance=self_illumination_luminances, colorTemperature=self_illumination_color)
code_block_13 = CodeBlock { -500; }
slider_3 = Orchid.RevitMaterial.Visual.Texture.Slider(value=code_block_13)
setBump = Orchid.RevitMaterial.Appearance.SetBump(appearance=setSelfIllumination, texture=image, amount=slider_3)
code_block_14 = CodeBlock { Color.ByARGB(255, 50, 115, 65); }
setTint = Orchid.RevitMaterial.Appearance.SetTint(appearance=setBump, color=code_block_14)
