# Dynamo graph Graphics.dyn (Dynamo 2.19.3.6394)
# packages: Orchid 2.19.3.6432

# group: Create, Get
# File: defaultProject
code_block = CodeBlock { "_test2"; }
create = Orchid.RevitMaterial.Material.Create(name=code_block)
boolean = BoolSelector(false)  # graph input
code_block_2 = CodeBlock { DSCore.Color.ByARGB(255,25,60,30); 50; }
code_block_3 = CodeBlock { "Earth"; }
getByName = FillPatternElement.GetByName(name=code_block_3)
code_block_4 = CodeBlock { 45; 85; 65; }
byARGB = Color.ByARGB(red=code_block_4.out0, green=code_block_4.out1, blue=code_block_4.out2)
input = Orchid.RevitMaterial.Graphics.Input(material=create, useRenderAppearance=boolean, shadingColor=code_block_2.out0, transparency=code_block_2.out1, surfaceForegroundPattern=getByName, surfaceForegroundPatternColor=byARGB, cutBackgroundPattern=getByName, cutBackgroundPatternColor=byARGB)
value = Orchid.RevitMaterial.Graphics.Value(material=input)
watch = Watch(value.Transparency)
watch_2 = Watch(value.ShadingColor)
watch_3 = Watch(value.UseRenderAppearance)
watch_4 = Watch(create)
name = Material.Name(material=create)
watch_5 = Watch(name)
watch_6 = Watch(value.surfaceForegroundPatternColor)
watch_7 = Watch(value.surfaceBackgroundPattern)
watch_8 = Watch(value.surfaceForegroundPattern)
watch_9 = Watch(value.surfaceBackgroundPatternColor)
watch_10 = Watch(value.cutForegroundPatternColor)
watch_11 = Watch(value.cutBackgroundPatternColor)
watch_12 = Watch(value.cutForegroundPattern)
watch_13 = Watch(value.cutBackgroundPattern)
fill_patterns = FillPatterns("Earth")  # graph input

# group: Smoothness, Shininess
code_block_5 = CodeBlock { "_test1"; }
create_2 = Orchid.RevitMaterial.Material.Create(name=code_block_5)
code_block_6 = CodeBlock { 50; }
setShininess = Orchid.RevitMaterial.Graphics.SetShininess(material=create_2, shininess=code_block_6)
shininess = Orchid.RevitMaterial.Graphics.Shininess(material=setShininess)
watch_14 = Watch(shininess)
setSmoothness = Orchid.RevitMaterial.Graphics.SetSmoothness(material=create_2, smoothness=code_block_6)
smoothness = Orchid.RevitMaterial.Graphics.Smoothness(material=setSmoothness)
watch_15 = Watch(smoothness)

# group: Create, Set Render Appearance, SetShadingColor, Set Transparency, Set Surface Pattern, Set Surface Pattern Color, Set Cut Pattern, Set Cut Pattern Color
code_block_7 = CodeBlock { "_test3"; }
create_3 = Orchid.RevitMaterial.Material.Create(name=code_block_7)
code_block_8 = CodeBlock { "Diagonal down 3.0mm"; }
getByName_2 = FillPatternElement.GetByName(name=code_block_8)
setCutBackgroundPattern = Orchid.RevitMaterial.Graphics.SetCutBackgroundPattern(material=create_3, pattern=getByName_2)
watch_16 = Watch(setCutBackgroundPattern)
code_block_9 = CodeBlock { 55; 125; 85; }
byARGB_2 = Color.ByARGB(red=code_block_9.out0, green=code_block_9.out1, blue=code_block_9.out2)
setCutBackgroundPatternColor = Orchid.RevitMaterial.Graphics.SetCutBackgroundPatternColor(material=setCutBackgroundPattern, color=byARGB_2)
cutBackgroundPatternColor = Orchid.RevitMaterial.Graphics.CutBackgroundPatternColor(material=setCutBackgroundPatternColor)
watch_17 = Watch(cutBackgroundPatternColor)
setSurfaceBackgroundPattern = Orchid.RevitMaterial.Graphics.SetSurfaceBackgroundPattern(material=create_3, pattern=getByName_2)
setSurfaceBackgroundPatternColor = Orchid.RevitMaterial.Graphics.SetSurfaceBackgroundPatternColor(material=setSurfaceBackgroundPattern, color=byARGB_2)
cutBackgroundPattern = Orchid.RevitMaterial.Graphics.CutBackgroundPattern(material=setSurfaceBackgroundPatternColor)
watch_18 = Watch(cutBackgroundPattern)
watch_19 = Watch(setSurfaceBackgroundPattern)
code_block_10 = CodeBlock { "Diagonal crosshatch 3.0mm"; }
getByName_3 = FillPatternElement.GetByName(name=code_block_10)
setCutForegroundPattern = Orchid.RevitMaterial.Graphics.SetCutForegroundPattern(material=create_3, pattern=getByName_3)
code_block_11 = CodeBlock { DSCore.Color.ByARGB(255,145,185,165); }
setCutForegroundPatternColor = Orchid.RevitMaterial.Graphics.SetCutForegroundPatternColor(material=setCutForegroundPattern, color=code_block_11)
cutForegroundPatternColor = Orchid.RevitMaterial.Graphics.CutForegroundPatternColor(material=setCutForegroundPatternColor)
watch_20 = Watch(cutForegroundPatternColor)
setSurfaceForegroundPattern = Orchid.RevitMaterial.Graphics.SetSurfaceForegroundPattern(material=create_3, pattern=getByName_3)
setSurfaceForegroundPatternColor = Orchid.RevitMaterial.Graphics.SetSurfaceForegroundPatternColor(material=setSurfaceForegroundPattern, color=code_block_11)
cutForegroundPattern = Orchid.RevitMaterial.Graphics.CutForegroundPattern(material=setSurfaceForegroundPatternColor)
watch_21 = Watch(cutForegroundPattern)
watch_22 = Watch(setCutForegroundPattern)
watch_23 = Watch(setSurfaceForegroundPattern)
code_block_12 = CodeBlock { 75; }
setTransparency = Orchid.RevitMaterial.Graphics.SetTransparency(material=create_3, transparency=code_block_12)
transparency = Orchid.RevitMaterial.Graphics.Transparency(material=setTransparency)
watch_24 = Watch(transparency)
code_block_13 = CodeBlock { DSCore.Color.ByARGB(255,25,60,30); }
setShadingColor = Orchid.RevitMaterial.Graphics.SetShadingColor(material=create_3, color=code_block_13)
shadingColor = Orchid.RevitMaterial.Graphics.ShadingColor(material=setShadingColor)
watch_25 = Watch(shadingColor)
boolean_2 = BoolSelector(false)  # graph input
setRenderAppearance = Orchid.RevitMaterial.Graphics.SetRenderAppearance(material=create_3, useRenderAppearance=boolean_2)
renderAppearance = Orchid.RevitMaterial.Graphics.RenderAppearance(material=setRenderAppearance)
watch_26 = Watch(renderAppearance)
watch_27 = Watch(create_3)
name_2 = Material.Name(material=create_3)
watch_28 = Watch(name_2)
