# Dynamo graph Physical-Thermal-Concrete.dyn (Dynamo 3.6.2.11575)
# packages: Orchid 3.6.0.6844

# group: Create material: Concrete (C30)
# File: defaultProject
boolean = BoolSelector(true)  # graph input
code_block = CodeBlock { "_Concrete"; }
physical_type = PhysicalType("Concrete")  # graph input
create = Orchid.RevitMaterial.Physical.Create(name=code_block, type=physical_type)
code_block_2 = CodeBlock()
# ---------- code_block_2.designscript (6 lines) ----------
"Concrete f'c=30 MPa";
"structural,concrete,CC:BS 8110";
"thermal,solid";
"Concrete";
"Orchid generated";
"https://github.com/erfajo/OrchidForDynamo";
# ----------------------------------------
addInformation = Orchid.RevitMaterial.Physical.AddInformation(propertySet=create, description=code_block_2.out0, keywords=code_block_2.out1, subclass=code_block_2.out3, source=code_block_2.out4, sourceUrl=code_block_2.out5)
physical_behavior = PhysicalBehavior("Isotropic")  # graph input
applyBehavior = Orchid.RevitMaterial.Physical.ApplyBehavior(propertySet=addInformation, behavior=physical_behavior)
thermal_type = ThermalType("Solid")  # graph input
create_2 = Orchid.RevitMaterial.Thermal.Create(name=code_block, type=thermal_type)
addInformation_2 = Orchid.RevitMaterial.Thermal.AddInformation(propertySet=create_2, description=code_block_2.out0, keywords=code_block_2.out2, subclass=code_block_2.out3, source=code_block_2.out4, sourceUrl=code_block_2.out5)
code_block_3 = CodeBlock { 0.00001; }
applyBasicThermal = Orchid.RevitMaterial.Physical.ApplyBasicThermal(propertySet=applyBehavior, expansionCoefficient=code_block_3)
code_block_4 = CodeBlock { 20500; 0.2; 11200; 2406.45; }
applyMechanical = Orchid.RevitMaterial.Physical.ApplyMechanical(propertySet=applyBasicThermal, youngModulus=code_block_4.out0, poissonRatio=code_block_4.out1, shearModulus=code_block_4.out2, density=code_block_4.out3)
boolean_2 = BoolSelector(false)  # graph input
physical_behavior_2 = PhysicalBehavior("Isotropic")  # graph input
code_block_5 = CodeBlock { 1.046; 0.657; 2300; 0.95; 182.4; 0.01; 0; 2000000; }
setProperties = Orchid.RevitMaterial.Thermal.ApplyProperties(propertySet=addInformation_2, transmitsLight=boolean_2, behavior=physical_behavior_2, thermalConductivity=code_block_5.out0, specificHeat=code_block_5.out1, density=code_block_5.out2, emissivity=code_block_5.out3, permeability=code_block_5.out4, porosity=code_block_5.out5, reflectivity=code_block_5.out6, electricalResistivity=code_block_5.out7)  # "Thermal.SetProperties"
create_3 = Orchid.RevitMaterial.Material.Create(name=code_block)
material_aspect = MaterialAspect("Thermal")  # graph input
applyThermal = Orchid.RevitMaterial.Material.ApplyThermal(material=create_3, aspect=material_aspect, propertySet=setProperties)
name = Material.Name(material=applyThermal)
watch = Watch(name)
watch_2 = Watch(applyThermal)
material_aspect_2 = MaterialAspect("Physical (Structural)")  # graph input
code_block_6 = CodeBlock { 30.0; 1.0; }
boolean_3 = BoolSelector(false)  # graph input
applyConcrete = Orchid.RevitMaterial.Physical.ApplyConcrete(propertySet=applyMechanical, compression=code_block_6.out0, shearStrengthReduction=code_block_6.out1, lightweight=boolean_3)
applyPhysical = Orchid.RevitMaterial.Material.ApplyPhysical(material=create_3, aspect=material_aspect_2, propertySet=applyConcrete)
name_2 = Material.Name(material=applyPhysical)
watch_3 = Watch(name_2)
watch_4 = Watch(applyPhysical)
name_3 = Element.Name(element=setProperties)
byName = Orchid.RevitMaterial.Thermal.ByName(name=name_3)
watch_5 = Watch(byName)
name_4 = Element.Name(element=applyConcrete)
byName_2 = Orchid.RevitMaterial.Physical.ByName(name=name_4)
watch_6 = Watch(byName_2)
watch_7 = Watch(name_3)
watch_8 = Watch(name_4)

information = Orchid.RevitMaterial.Physical.Information(propertySet=addInformation)
watch_9 = Watch(information.Keywords)
watch_10 = Watch(information.Subclass)
watch_11 = Watch(information.Source)
watch_12 = Watch(information.SourceUrl)
behavior = Orchid.RevitMaterial.Physical.Behavior(propertySet=applyBehavior)
watch_13 = Watch(behavior)
watch_14 = Watch(information.Description)
information_2 = Orchid.RevitMaterial.Thermal.Information(propertySet=addInformation_2)
watch_15 = Watch(information_2.d4)
watch_16 = Watch(information_2.d3)
watch_17 = Watch(information_2.d2)
watch_18 = Watch(information_2.d1)
watch_19 = Watch(information_2.d0)
youngModulus = Orchid.RevitMaterial.Physical.YoungModulus(propertySet=applyMechanical)
watch_20 = Watch(youngModulus.d1)
watch_21 = Watch(youngModulus.d2)
watch_22 = Watch(youngModulus.d3)
watch_23 = Watch(youngModulus.d4)
watch_24 = Watch(youngModulus.d5)
expansionCoefficient = Orchid.RevitMaterial.Physical.ExpansionCoefficient(propertySet=applyBasicThermal)
watch_25 = Watch(expansionCoefficient.d1)
watch_26 = Watch(expansionCoefficient.d2)
watch_27 = Watch(expansionCoefficient.d3)
watch_28 = Watch(expansionCoefficient.d4)
watch_29 = Watch(expansionCoefficient.d5)
watch_30 = Watch(youngModulus.d0)
watch_31 = Watch(expansionCoefficient.d0)
properties = Orchid.RevitMaterial.Thermal.Properties(propertySet=setProperties)
watch_32 = Watch(properties.d2)
watch_33 = Watch(properties.d3)
watch_34 = Watch(properties.d4)
watch_35 = Watch(properties.d1)
watch_36 = Watch(properties.d0)
poissonRatio = Orchid.RevitMaterial.Physical.PoissonRatio(propertySet=applyMechanical)
watch_37 = Watch(poissonRatio.d1)
watch_38 = Watch(poissonRatio.d2)
watch_39 = Watch(poissonRatio.d3)
watch_40 = Watch(poissonRatio.d4)
watch_41 = Watch(poissonRatio.d5)
watch_42 = Watch(properties.d9)
watch_43 = Watch(properties.d8)
watch_44 = Watch(properties.d7)
watch_45 = Watch(properties.d6)
watch_46 = Watch(properties.d5)
watch_47 = Watch(poissonRatio.d0)
shearModulus = Orchid.RevitMaterial.Physical.ShearModulus(propertySet=applyMechanical)
watch_48 = Watch(shearModulus.d1)
watch_49 = Watch(shearModulus.d2)
watch_50 = Watch(shearModulus.d0)
watch_51 = Watch(shearModulus.d3)
watch_52 = Watch(shearModulus.d4)
concrete = Orchid.RevitMaterial.Physical.Concrete(propertySet=applyConcrete)
watch_53 = Watch(concrete.d1)
watch_54 = Watch(concrete.d2)
watch_55 = Watch(concrete.d0)
density = Orchid.RevitMaterial.Physical.Density(propertySet=applyMechanical)
watch_56 = Watch(density)
