# Dynamo graph Physical-Thermal-Gas.dyn (Dynamo 3.6.2.11575)
# packages: Orchid 3.6.0.6844

# group: Create material: Oxygen
# File: defaultProject
boolean = BoolSelector(true)  # graph input
code_block = CodeBlock { "_Oxygen"; }
physical_type = PhysicalType("Gas")  # graph input
create = Orchid.RevitMaterial.Physical.Create(name=code_block, type=physical_type)
code_block_2 = CodeBlock()
# ---------- code_block_2.designscript (6 lines) ----------
"Oxygen, properties at atmospheric pressure";
"structural,gas";
"thermal,gas";
"Gas";
"Orchid generated";
"https://github.com/erfajo/OrchidForDynamo";
# ----------------------------------------
addInformation = Orchid.RevitMaterial.Physical.AddInformation(propertySet=create, description=code_block_2.out0, keywords=code_block_2.out1, subclass=code_block_2.out3, source=code_block_2.out4, sourceUrl=code_block_2.out5)
code_block_3 = CodeBlock { 500; }
applyBasicThermal = Orchid.RevitMaterial.Physical.ApplyBasicThermal(propertySet=addInformation, expansionCoefficient=code_block_3)
code_block_4 = CodeBlock { 1.35; }
applyMechanical = Orchid.RevitMaterial.Physical.ApplyMechanical(propertySet=applyBasicThermal, density=code_block_4)
thermal_type = ThermalType("Gas")  # graph input
create_2 = Orchid.RevitMaterial.Thermal.Create(name=code_block, type=thermal_type)
addInformation_2 = Orchid.RevitMaterial.Thermal.AddInformation(propertySet=create_2, description=code_block_2.out0, keywords=code_block_2.out2, subclass=code_block_2.out3, source=code_block_2.out4, sourceUrl=code_block_2.out5)
code_block_5 = CodeBlock { 0.0242; 0.9118; 1.35; 0.01; 0; 1; }
setBasicThermal = Orchid.RevitMaterial.Thermal.ApplyBasicThermal(propertySet=addInformation_2, thermalConductivity=code_block_5.out0, specificHeat=code_block_5.out1, density=code_block_5.out2, emissivity=code_block_5.out3, gasViscosity=code_block_5.out4, compressibility=code_block_5.out5)  # "Thermal.SetBasicThermal"
create_3 = Orchid.RevitMaterial.Material.Create(name=code_block)
material_aspect = MaterialAspect("Thermal")  # graph input
applyThermal = Orchid.RevitMaterial.Material.ApplyThermal(material=create_3, aspect=material_aspect, propertySet=setBasicThermal)
watch = Watch(applyThermal)
name = Material.Name(material=applyThermal)
watch_2 = Watch(name)
material_aspect_2 = MaterialAspect("Physical (Structural)")  # graph input
applyPhysical = Orchid.RevitMaterial.Material.ApplyPhysical(material=create_3, aspect=material_aspect_2, propertySet=applyMechanical)
watch_3 = Watch(applyPhysical)
name_2 = Material.Name(material=applyPhysical)
watch_4 = Watch(name_2)

information = Orchid.RevitMaterial.Physical.Information(propertySet=addInformation)
watch_5 = Watch(information.SourceUrl)
watch_6 = Watch(information.Source)
watch_7 = Watch(information.Subclass)
watch_8 = Watch(information.Keywords)
watch_9 = Watch(information.Description)
density = Orchid.RevitMaterial.Physical.Density(propertySet=applyMechanical)
watch_10 = Watch(density)
information_2 = Orchid.RevitMaterial.Thermal.Information(propertySet=addInformation_2)
watch_11 = Watch(information_2.d2)
watch_12 = Watch(information_2.d1)
watch_13 = Watch(information_2.d0)
watch_14 = Watch(information_2.d3)
watch_15 = Watch(information_2.d4)
basicThermal = Orchid.RevitMaterial.Thermal.BasicThermal(propertySet=setBasicThermal)
watch_16 = Watch(basicThermal.d2)
watch_17 = Watch(basicThermal.d3)
watch_18 = Watch(basicThermal.d4)
watch_19 = Watch(basicThermal.d1)
watch_20 = Watch(basicThermal.d0)
expansionCoefficient = Orchid.RevitMaterial.Physical.ExpansionCoefficient(propertySet=applyBasicThermal)
watch_21 = Watch(expansionCoefficient.d5)
watch_22 = Watch(expansionCoefficient.d4)
watch_23 = Watch(expansionCoefficient.d3)
watch_24 = Watch(expansionCoefficient.d2)
watch_25 = Watch(expansionCoefficient.d1)
watch_26 = Watch(expansionCoefficient.d0)
watch_27 = Watch(basicThermal.d5)
