# Dynamo graph Physical-Thermal-Steel.dyn (Dynamo 2.16.2.5624)
# packages: Orchid 2.16.4.6196

# group: Create material: Steel (S275)
# File: defaultProject
code_block = CodeBlock { "_Steel S275"; }
physical_type = PhysicalType("Metal")  # graph input
create = Orchid.RevitMaterial.Physical.Create(name=code_block, type=physical_type)
code_block_2 = CodeBlock()
# ---------- code_block_2.designscript (6 lines) ----------
"Steel, S275 (EN 10025-2)";
"1.0044,structural,metal,CC:EN 10025";
"thermal,solid";
"Steel";
"Orchid generated";
"https://github.com/erfajo/OrchidForDynamo";
# ----------------------------------------
setInformation = Orchid.RevitMaterial.Physical.SetInformation(propertySet=create, description=code_block_2.out0, keywords=code_block_2.out1, subclass=code_block_2.out3, source=code_block_2.out4, sourceUrl=code_block_2.out5)
boolean = BoolSelector(true)  # graph input
thermal_type = ThermalType("Solid")  # graph input
create_2 = Orchid.RevitMaterial.Thermal.Create(name=code_block, type=thermal_type)
setInformation_2 = Orchid.RevitMaterial.Thermal.SetInformation(propertySet=create_2, description=code_block_2.out0, keywords=code_block_2.out2, subclass=code_block_2.out3, source=code_block_2.out4, sourceUrl=code_block_2.out5)
physical_behavior = PhysicalBehavior("Isotropic")  # graph input
setBehavior = Orchid.RevitMaterial.Physical.SetBehavior(propertySet=setInformation, behavior=physical_behavior)
code_block_3 = CodeBlock { 0.00001; }
setBasicThermal = Orchid.RevitMaterial.Physical.SetBasicThermal(propertySet=setBehavior, expansionCoefficient=code_block_3)
code_block_4 = CodeBlock { 205000; 0.3; 80000; 7850; }
setMechanical = Orchid.RevitMaterial.Physical.SetMechanical(propertySet=setBasicThermal, youngModulus=code_block_4.out0, poissonRatio=code_block_4.out1, shearModulus=code_block_4.out2, density=code_block_4.out3)
boolean_2 = BoolSelector(false)  # graph input
physical_behavior_2 = PhysicalBehavior("Isotropic")  # graph input
code_block_5 = CodeBlock { 45; 0.48; 7850; 0.4; 0; 0.01; 0; 0; }
setProperties = Orchid.RevitMaterial.Thermal.SetProperties(propertySet=setInformation_2, transmitsLight=boolean_2, behavior=physical_behavior_2, thermalConductivity=code_block_5.out0, specificHeat=code_block_5.out1, density=code_block_5.out2, emissivity=code_block_5.out3, permeability=code_block_5.out4, porosity=code_block_5.out5, reflectivity=code_block_5.out6, electricalResistivity=code_block_5.out7)
code_block_6 = CodeBlock { 275; 430; }
boolean_3 = BoolSelector(false)  # graph input
setStrength = Orchid.RevitMaterial.Physical.SetStrength(propertySet=setMechanical, yieldStress=code_block_6.out0, tensileStrength=code_block_6.out1, thermalTreated=boolean_3)
create_3 = Orchid.RevitMaterial.Material.Create(name=code_block)
material_aspect = MaterialAspect("Thermal")  # graph input
setThermal = Orchid.RevitMaterial.Material.SetThermal(material=create_3, aspect=material_aspect, propertySet=setProperties)
watch = Watch(setThermal)
name = Material.Name(material=setThermal)
watch_2 = Watch(name)
material_aspect_2 = MaterialAspect("Physical (Structural)")  # graph input
setPhysical = Orchid.RevitMaterial.Material.SetPhysical(material=create_3, aspect=material_aspect_2, propertySet=setStrength)
watch_3 = Watch(setPhysical)
name_2 = Material.Name(material=setPhysical)
watch_4 = Watch(name_2)

information = Orchid.RevitMaterial.Physical.Information(propertySet=setInformation)
watch_5 = Watch(information.Subclass)
watch_6 = Watch(information.Source)
watch_7 = Watch(information.SourceUrl)
watch_8 = Watch(information.Keywords)
watch_9 = Watch(information.Description)
behavior = Orchid.RevitMaterial.Physical.Behavior(propertySet=setInformation)
watch_10 = Watch(behavior)
information_2 = Orchid.RevitMaterial.Thermal.Information(propertySet=setInformation_2)
watch_11 = Watch(information_2.SourceUrl)
watch_12 = Watch(information_2.Source)
watch_13 = Watch(information_2.Subclass)
watch_14 = Watch(information_2.Keywords)
watch_15 = Watch(information_2.Description)
youngModulus = Orchid.RevitMaterial.Physical.YoungModulus(propertySet=setMechanical)
watch_16 = Watch(youngModulus.YoungModulusY)
watch_17 = Watch(youngModulus.YoungModulusZ)
watch_18 = Watch(youngModulus.YoungModulus1)
watch_19 = Watch(youngModulus.YoungModulusX)
watch_20 = Watch(youngModulus.YoungModulus2)
expansionCoefficient = Orchid.RevitMaterial.Physical.ExpansionCoefficient(propertySet=setBasicThermal)
watch_21 = Watch(expansionCoefficient.ExpansionCoefficientX)
watch_22 = Watch(expansionCoefficient.ExpansionCoefficientY)
watch_23 = Watch(expansionCoefficient.ExpansionCoefficientZ)
watch_24 = Watch(expansionCoefficient.ExpansionCoefficient1)
watch_25 = Watch(expansionCoefficient.ExpansionCoefficient2)
watch_26 = Watch(youngModulus.YoungModulus)
watch_27 = Watch(expansionCoefficient.ExpansionCoefficient)
properties = Orchid.RevitMaterial.Thermal.Properties(propertySet=setProperties)
watch_28 = Watch(properties.ThermalConductivity)
watch_29 = Watch(properties.SpecificHeat)
watch_30 = Watch(properties.Density)
watch_31 = Watch(properties.Behavior)
watch_32 = Watch(properties.TransmitsLight)
watch_33 = Watch(properties.ElectricalResistivity)
watch_34 = Watch(properties.Reflectivity)
watch_35 = Watch(properties.Porosity)
watch_36 = Watch(properties.Permeability)
watch_37 = Watch(properties.Emissivity)
poissonRatio = Orchid.RevitMaterial.Physical.PoissonRatio(propertySet=setMechanical)
watch_38 = Watch(poissonRatio.PoissonRatioX)
watch_39 = Watch(poissonRatio.PoissonRatioY)
watch_40 = Watch(poissonRatio.PoissonRatioZ)
watch_41 = Watch(poissonRatio.PoissonRatio12)
watch_42 = Watch(poissonRatio.PoissonRatio23)
watch_43 = Watch(poissonRatio.PoissonRatio)
strength = Orchid.RevitMaterial.Physical.Strength(propertySet=setStrength)
watch_44 = Watch(strength.ThermalTreated)
watch_45 = Watch(strength.TensileStrength)
watch_46 = Watch(strength.YieldStress)
shearModulus = Orchid.RevitMaterial.Physical.ShearModulus(propertySet=setMechanical)
watch_47 = Watch(shearModulus.ShearModulusX)
watch_48 = Watch(shearModulus.ShearModulusY)
watch_49 = Watch(shearModulus.ShearModulus)
watch_50 = Watch(shearModulus.ShearModulusZ)
watch_51 = Watch(shearModulus.ShearModulus12)
density = Orchid.RevitMaterial.Physical.Density(propertySet=setMechanical)
watch_52 = Watch(density)
