# Dynamo graph DesignOptions.dyn (Dynamo 2.19.3.6394)
# packages: Orchid 2.19.3.6432

# group: DesignOption
# File: defaultProject-extended
inDocument = Orchid.RevitProject.Common.DesignOption.InDocument()
watch = Watch(inDocument)
current = Orchid.RevitProject.Common.Document.Current()
inDocument_2 = Orchid.RevitProject.Common.DesignOption.InDocument(document=current)
watch_2 = Watch(inDocument_2)
name = Element.Name(element=inDocument_2)
watch_3 = Watch(name)

# group: DesignOptionSet
# File: defaultProject-extended
current_2 = Orchid.RevitProject.Common.Document.Current()
inDocument_3 = Orchid.RevitProject.Common.DesignOptionSet.InDocument(document=current_2)
watch_4 = Watch(inDocument_3)
name_2 = Element.Name(element=inDocument_3)
watch_5 = Watch(name_2)
inDocument_4 = Orchid.RevitProject.Common.DesignOptionSet.InDocument()
watch_6 = Watch(inDocument_4)

# group: DesignOptionSet By Name ... and get elements
code_block = CodeBlock { "Option Set 1"; "Option Set 2"; }
byName = Orchid.RevitProject.Common.DesignOptionSet.ByName(name=code_block.out0)
watch_7 = Watch(byName)
elementInPrimary = Orchid.RevitProject.Common.DesignOptionSet.ElementInPrimary(designOptionSet=byName)
watch_8 = Watch(elementInPrimary)

# group: Get DesignOptionSet by DesignOption
design_options = DesignOption("Floor_Option 1  <primary>")
byDesignOption = Orchid.RevitProject.Common.DesignOptionSet.ByDesignOption(designOption=design_options)
watch_9 = Watch(byDesignOption)
name_3 = Element.Name(element=byDesignOption)
watch_10 = Watch(name_3)

# group: Get elements in DesignOption
design_options_2 = DesignOption("Floor_Option 1  <primary>")
element = Orchid.RevitProject.Common.DesignOption.Element(designOption=design_options_2)
watch_11 = Watch(element)
elementInPrimary_2 = Orchid.RevitProject.Common.DesignOption.ElementInPrimary()
watch_12 = Watch(elementInPrimary_2)

# group: Is primary design option?
design_options_3 = DesignOption("Floor_Option 2")
isPrimary = Orchid.RevitProject.Common.DesignOption.IsPrimary(designOption=design_options_3)
watch_13 = Watch(isPrimary)

# group: Get DesignOption by DesignOptionSet
inDocument_5 = Orchid.RevitProject.Common.DesignOptionSet.InDocument()
byDesignOptionSet = Orchid.RevitProject.Common.DesignOption.ByDesignOptionSet(designOptionSet=inDocument_5)
watch_14 = Watch(byDesignOptionSet)
