# Dynamo graph LightSource_FamilyType.dyn (Dynamo 2.19.3.6394)
# packages: Orchid 2.19.3.6432

inDocument = Orchid.RevitProject.Elements.FamilyType.InDocument()
watch = Watch(inDocument.FamilyType)
watch_2 = Watch(inDocument.Category)

# group: collect
# File: Electrical_Basic
code_block = CodeBlock { "LundtofteLamp"; }
byName = Orchid.RevitProject.Elements.Family.ByName(name=code_block)
types = Family.Types(family=byName)

# group: Set light color filter data
code_block_2 = CodeBlock(familyType=types)
# ---------- code_block_2.designscript (3 lines) ----------
familyType;
Color.ByARGB
(0, 127, 127, 127);
# ----------------------------------------
setLightColorFilter = Orchid.RevitProject.Elements.FamilyType.SetLightColorFilter(familyType=code_block_2.familyType, color=code_block_2.out1)

# group: Get light color filter data
lightColorFilter = Orchid.RevitProject.Elements.FamilyType.LightColorFilter(familyType=setLightColorFilter)
watch_3 = Watch(lightColorFilter)

# group: Set light distribution data
code_block_3 = CodeBlock(familyType=types) { familyType; "Spherical"; }
light_distribution_styles = LightDistributionStyle("Spot light distribution")
setLightDistribution = Orchid.RevitProject.Elements.FamilyType.SetLightDistribution(familyType=code_block_3.familyType, style=light_distribution_styles)

# group: Get light distribution data
lightDistribution = Orchid.RevitProject.Elements.FamilyType.LightDistribution(familyType=setLightDistribution)
watch_4 = Watch(lightDistribution.Style)
watch_5 = Watch(lightDistribution.Value)

# group: Set light shape data
code_block_4 = CodeBlock(familyType=types) { familyType; "Point"; }
light_shape_styles = LightShapeStyle("Rectangle")
setLightShape = Orchid.RevitProject.Elements.FamilyType.SetLightShape(familyType=code_block_4.familyType, style=light_shape_styles)

# group: Get light shape data
lightShape = Orchid.RevitProject.Elements.FamilyType.LightShape(familyType=setLightShape)
watch_6 = Watch(lightShape.Style)
watch_7 = Watch(lightShape.Value)

# group: Set light dimming color data
code_block_5 = CodeBlock(familyType=types) { familyType; "None"; }
light_dimming_colors = LightDimmingColor("Incandescent lamp curve dimming color")
setLightDimmingColor = Orchid.RevitProject.Elements.FamilyType.SetLightDimmingColor(familyType=code_block_5.familyType, color=light_dimming_colors)

# group: Get light dimming color data
lightDimmingColor = Orchid.RevitProject.Elements.FamilyType.LightDimmingColor(familyType=setLightDimmingColor)
watch_8 = Watch(lightDimmingColor)

# group: Set light color
code_block_6 = CodeBlock(familyType=types)
# ---------- code_block_6.designscript (6 lines) ----------
familyType;
// Style
"PresetColor";

3100;
"FluorescentWarm";
# ----------------------------------------
setLightCustomColor = Orchid.RevitProject.Elements.FamilyType.SetLightCustomColor(familyType=code_block_6.familyType, value=code_block_6.out2)  # frozen
light_color_presets = ColorPreset("Fluorescent (Warm White)")
setLightPresetColor = Orchid.RevitProject.Elements.FamilyType.SetLightPresetColor(familyType=code_block_6.familyType, color=light_color_presets)  # frozen
light_color_styles = InitialColor("Custom color")
setLightColor = Orchid.RevitProject.Elements.FamilyType.SetLightColor(familyType=code_block_6.familyType, style=light_color_styles, color=light_color_presets, value=code_block_6.out2)

# group: Get light color
lightColor = Orchid.RevitProject.Elements.FamilyType.LightColor(familyType=setLightCustomColor)
watch_9 = Watch(lightColor.Value)
lightColor_2 = Orchid.RevitProject.Elements.FamilyType.LightColor(familyType=setLightPresetColor)
watch_10 = Watch(lightColor_2.Value)
lightColor_3 = Orchid.RevitProject.Elements.FamilyType.LightColor(familyType=setLightColor)
watch_11 = Watch(lightColor_3.Style)
watch_12 = Watch(lightColor_3.Value)

# group: Set light intensity
code_block_7 = CodeBlock(familyType=types)
# ---------- code_block_7.designscript (14 lines) ----------
familyType;
// Style
"Flux";

// Wattage
10;
150;
// Flux
1400;
// Luminous
440;
// lluminance
50;
3048;
# ----------------------------------------
setLightWattageIntensity = Orchid.RevitProject.Elements.FamilyType.SetLightWattageIntensity(familyType=code_block_7.familyType, wattage=code_block_7.out2, efficacy=code_block_7.out3)  # frozen
setLightFluxIntensity = Orchid.RevitProject.Elements.FamilyType.SetLightFluxIntensity(familyType=code_block_7.familyType, value=code_block_7.out4)  # frozen
setLightLuminousIntensity = Orchid.RevitProject.Elements.FamilyType.SetLightLuminousIntensity(familyType=code_block_7.familyType, value=code_block_7.out5)  # frozen
setLightIlluminanceIntensity = Orchid.RevitProject.Elements.FamilyType.SetLightIlluminanceIntensity(familyType=code_block_7.familyType, illuminance=code_block_7.out6, distance=code_block_7.out7)  # frozen
light_intensities = InitialIntensity("Flux intensity")
setLightIntensity = Orchid.RevitProject.Elements.FamilyType.SetLightIntensity(familyType=code_block_7.familyType, style=light_intensities, valueA=code_block_7.out4)

# group: Get light intensity
lightIntensity = Orchid.RevitProject.Elements.FamilyType.LightIntensity(familyType=setLightWattageIntensity)
watch_13 = Watch(lightIntensity.Value)
lightIntensity_2 = Orchid.RevitProject.Elements.FamilyType.LightIntensity(familyType=setLightFluxIntensity)
watch_14 = Watch(lightIntensity_2.Value)
lightIntensity_3 = Orchid.RevitProject.Elements.FamilyType.LightIntensity(familyType=setLightLuminousIntensity)
watch_15 = Watch(lightIntensity_3.Value)
lightIntensity_4 = Orchid.RevitProject.Elements.FamilyType.LightIntensity(familyType=setLightIlluminanceIntensity)
watch_16 = Watch(lightIntensity_4.Value)
lightIntensity_5 = Orchid.RevitProject.Elements.FamilyType.LightIntensity(familyType=setLightIntensity)
watch_17 = Watch(lightIntensity_5.Style)
watch_18 = Watch(lightIntensity_5.Value)

# group: Set light loss factor
code_block_8 = CodeBlock(familyType=types)
# ---------- code_block_8.designscript (7 lines) ----------
familyType;

// Style
"Basic";
3.0;
1.25;
0.75;
# ----------------------------------------
setBasicLossFactor = Orchid.RevitProject.Elements.FamilyType.SetBasicLossFactor(familyType=code_block_8.familyType, value=code_block_8.out2)  # frozen
setAdvancedLossFactor = Orchid.RevitProject.Elements.FamilyType.SetAdvancedLossFactor(familyType=code_block_8.familyType, temperature=code_block_8.out3, voltage=code_block_8.out3, ballast=code_block_8.out4, tilt=code_block_8.out4, surface=code_block_8.out4, lumen=code_block_8.out4, luminaire=code_block_8.out4)  # frozen
light_loss_factors = LossFactor("Basic loss factor")
setLightLossFactor = Orchid.RevitProject.Elements.FamilyType.SetLightLossFactor(familyType=code_block_8.familyType, style=light_loss_factors, value=code_block_8.out2, temperature=code_block_8.out3, voltage=code_block_8.out3, ballast=code_block_8.out4, tilt=code_block_8.out4, surface=code_block_8.out4, lumen=code_block_8.out4, luminaire=code_block_8.out4)

# group: Get light loss factor
lightLossFactor = Orchid.RevitProject.Elements.FamilyType.LightLossFactor(familyType=setBasicLossFactor)
watch_19 = Watch(lightLossFactor.Value)
lightLossFactor_2 = Orchid.RevitProject.Elements.FamilyType.LightLossFactor(familyType=setAdvancedLossFactor)
watch_20 = Watch(lightLossFactor_2.Value)
lightLossFactor_3 = Orchid.RevitProject.Elements.FamilyType.LightLossFactor(familyType=setLightLossFactor)
watch_21 = Watch(lightLossFactor_3.Style)
watch_22 = Watch(lightLossFactor_3.Value)
