# Dynamo graph LineStyleChange.dyn (Dynamo 3.7.0.11777)
# packages: Orchid 2.19.5.6567

# group: Change line style
# File: emptyProject_line
code_block = CodeBlock { "<Centerline>"; "<Thin Lines>"; "Light Lines"; "Thick Lines"; }
byName = Orchid.Revit.Geometry.LineStyle.ByName(name=code_block.out0)
byLineStyle = Orchid.Revit.Geometry.CurveElement.ByLineStyle(lineStyle=byName)
byName_2 = Orchid.Revit.Geometry.LineStyle.ByName(name=code_block.out3)
setLineStyle = Orchid.Revit.Geometry.CurveElement.SetLineStyle(curve=byLineStyle, lineStyle=byName_2)

watch = Watch(setLineStyle)
