# Dynamo graph Group.dyn (Dynamo 2.19.3.6394)
# packages: Orchid 2.19.3.6432

# group: Create group
# File: defaultProject
code_block = CodeBlock()
# ---------- code_block.designscript (11 lines) ----------
"CategoryType";

"Model";
"Annotation";
"AnalyticalModel";
"Internal";

["Model",
"Annotation",
"AnalyticalModel",
"Internal"];
# ----------------------------------------
enumByName = Orchid.AdeskApp.Revit.EnumByName(enumType=code_block.out0, valueName=code_block.out1)
byCategoryType = Orchid.RevitProject.Elements.Element.ByCategoryType(categoryType=enumByName)
watch = Watch(byCategoryType.Element)
code_block_2 = CodeBlock { "test"; }
flatten = List.Flatten(list=byCategoryType.Element)
create = Orchid.Common.Group.Create(name=code_block_2, element=flatten)

# group: Group delete
code_block_3 = CodeBlock { "test"; }
delete = Orchid.Common.Group.Delete(name=code_block_3)  # frozen
byName = Orchid.Common.Group.ByName(name=code_block_3)
delete_2 = Orchid.Common.Group.Delete(group=byName)  # frozen
groups = Group("test")

# group: Group ungroup
code_block_4 = CodeBlock { "test"; }
unGroup = Orchid.Common.Group.Delete(name=code_block_4)  # "Group.UnGroup"; frozen
byName_2 = Orchid.Common.Group.ByName(name=code_block_4)
unGroup_2 = Orchid.Common.Group.Delete(group=byName_2)  # "Group.UnGroup"; frozen
groups_2 = Group("test")

# group: GroupType delete
code_block_5 = CodeBlock { "test"; }
delete_3 = Orchid.Common.GroupType.Delete(name=code_block_5)  # frozen
group_types = GroupType("test")
byName_3 = Orchid.Common.GroupType.ByName(name=code_block_5)
delete_4 = Orchid.Common.GroupType.Delete(groupType=byName_3)  # frozen
