# Dynamo graph Location Geo-Site.dyn (Dynamo 2.19.3.6394)
# packages: Orchid 2.19.3.6432

# group: Set Internal Position -> Survey point
# File: defaultProject_location
code_block = CodeBlock { "Internal"; }
byName = Orchid.RevitProject.Common.Location.ByName(name=code_block)
code_block_2 = CodeBlock { 0; }
setProjectPosition = Orchid.RevitProject.Common.Location.SetProjectPosition(element=byName, northSouth=code_block_2, eastWest=code_block_2, elevation=code_block_2, angle=code_block_2)

# group: Set Survey positions -> REMEMBER to set the DVR 90 elevation datum level
code_block_3 = CodeBlock()
# ---------- code_block_3.designscript (8 lines) ----------
// DK coordinate
"DKTM3";

// Local coordinate
"Copenhagen";

// DVR 90 elevation
48000;
# ----------------------------------------
byName_2 = Orchid.RevitProject.Common.Location.ByName(name=code_block_3.out0)
projectPosition = Orchid.RevitProject.Common.Location.ProjectPosition(element=byName_2)
setProjectPosition_2 = Orchid.RevitProject.Common.Location.SetProjectPosition(element=byName_2, northSouth=projectPosition.NorthSouth, eastWest=projectPosition.EastWest, elevation=code_block_3.out2, angle=projectPosition.Angle)
byName_3 = Orchid.RevitProject.Common.Location.ByName(name=code_block_3.out1)
projectPosition_2 = Orchid.RevitProject.Common.Location.ProjectPosition(element=byName_3)
setProjectPosition_3 = Orchid.RevitProject.Common.Location.SetProjectPosition(element=byName_3, northSouth=projectPosition_2.NorthSouth, eastWest=projectPosition_2.EastWest, elevation=code_block_3.out2, angle=projectPosition_2.Angle)

# group: Latitude and Longitude -> WGS 84
code_block_4 = CodeBlock()
# ---------- code_block_4.designscript (4 lines) ----------
// EPSG:4326 WGS 84
// Copenhagen
55.67601666;
12.56992672;
# ----------------------------------------
setSiteLocation = Orchid.RevitProject.Common.Location.SetSiteLocation(latitude=code_block_4.out0, longitude=code_block_4.out1)

# group: Site Coordinate
code_block_5 = CodeBlock()
# ---------- code_block_5.designscript (3 lines) ----------
// Geo ID -> DKTM3
"EPSG:4095";
"ETRF89.DKTM3";
# ----------------------------------------
setSiteCoordinate = Orchid.RevitProject.Common.Location.SetSiteCoordinate(geoID=code_block_5.out0)  # frozen
siteCoordinate = Orchid.RevitProject.Common.Location.SiteCoordinate(siteLocation=setSiteCoordinate)
watch = Watch(siteCoordinate.GeoID)

# group: Latitude and Longitude -> WGS 84
siteLocation = Orchid.RevitProject.Common.Location.SiteLocation()
watch_2 = Watch(siteLocation.Latitude)
watch_3 = Watch(siteLocation.Longitude)

# group: Site Coordinate
code_block_6 = CodeBlock()
# ---------- code_block_6.designscript (2 lines) ----------
// Site name
"Copenhagen";
# ----------------------------------------
setSiteName = Orchid.RevitProject.Common.Location.SetSiteName(name=code_block_6)
siteName = Orchid.RevitProject.Common.Location.SiteName(siteLocation=setSiteName)
watch_4 = Watch(siteName)

# group: TimeZone setter
code_block_7 = CodeBlock { 1; }
setTimeZone = Orchid.RevitProject.Common.Location.SetTimeZone(timeZone=code_block_7)
