# Dynamo graph ChangeMEPSystemClass.dyn (Dynamo 2.16.1.2727)
# packages: Orchid 216.3.0.5794

code_block = CodeBlock()
# ---------- code_block.designscript (3 lines) ----------
["Kølevand, 30% propylene gylkol, Frem",
"Kølevand, 30% propylene gylkol, Retur"];
["Cooling Supply","Cooling Return"];
# ----------------------------------------
byName = Orchid.RevitProject.Systems.MEPSystem.ByName(name=code_block.out0)
pipe = Orchid.RevitProject.Systems.Piping.Pipe(pipingSystem=byName)
byName_2 = Orchid.RevitProject.Systems.MEPSystemType.ByName(name=code_block.out1)
setSystemType = Orchid.RevitProject.Systems.Networks.Pipe.SetSystemType(element=pipe, systemType=byName_2)
